# Grasshopper definition saveOSM.gh (Grasshopper 0.9.76)
# plug-ins: Ironbug

nickname = Ironbug_CoilHeatingWater()
panel = Panel("C:\Users\Mingbo\Documents\GitHub\Ironbug\doc\osmFile\savedFromGH.osm")
airloop = Ironbug_AirLoopHVAC(Supply=nickname)
nickname_2 = Ironbug_SaveOSModel(FilePath=panel, Model=airloop)
