# Grasshopper definition Sys00_IdealAirLoad.gh (Grasshopper 1.0.7)

# ---- group: Sys00_Ideal Air Load
# Double click the component for more details
sys00 = Sys00()

# ==== cluster Sys00
hbrooms = ClusterInput()  # Honeybee Rooms to which the HVAC system should be assigned.

# ----
# HBRooms
data = Data(flatten(hbrooms))
idealairload = Ironbug_ZoneHVACIdealLoadsAirSystem(dupNum=False)

zonegroups = IB_ZoneGroups(_HBRooms=data)

lng = ListLength(List=zonegroups)
panel = Panel(lng)

duplicate = Ironbug_Duplicate(Reference=idealairload, Amount=panel)  # -> Objects, port
thermalzone = IB_ThermalZone(
    _HBRooms=zonegroups,
    ZoneEquipments_=duplicate.Objects,
    IsAirTerminalPriorToZoneEquipments=True,
    allowMultiAirloops=False,
    dupNum=False)

noairloop = Ironbug_NoAirLoop(OSZones=thermalzone)
hvacsystem = Ironbug_HVACSystem(AirLoops=flatten(noairloop))

hvacsystem_2 = ClusterOutput(hvacsystem)
