# Grasshopper definition Sys01_PTAC.gh (Grasshopper 1.0.7)

# ---- group: Sys01_PTAC
# Double click the component for more details
sys01 = Sys01()

# ==== cluster Sys01
hbrooms = ClusterInput()  # Honeybee Rooms to which the HVAC system should be assigned.

# ----
# HBRooms
# PTAC
data = Data(flatten(hbrooms))

zonegroups = IB_ZoneGroups(_HBRooms=data)
lng = ListLength(List=zonegroups)
coilhtnwater = Ironbug_CoilHeatingWater(dupNum=False)  # -> AirSide_CoilHeatingWater, WaterSide_CoilHeatingWater
objparams = IB_ObjParams(PressureRise="500", DataFieldSetType="Ironbug.HVAC.IB_FanConstantVolume_FieldSet")
panel = Panel(lng)
duplicate = Ironbug_Duplicate(Reference=coilhtnwater.AirSide_CoilHeatingWater, Amount=panel)  # -> Objects, graft(WaterSide_CoilHeatingWater)
fanconstant = Ironbug_FanConstantVolume(Parameters_=objparams, dupNum=False)
ptac = Ironbug_ZoneHVACPackagedTerminalAirConditioner(HeatingCoil=duplicate.Objects, Fan_=fanconstant, dupNum=False)
thermalzone = Ironbug_ThermalZone(
    HoneybeeZonesOrOsZones=zonegroups,
    ZoneEquipment=ptac,
    IsAirTerminalPriorToZoneEquipments=True,
    allowMultiAirloops=False,
    dupNum=False)

# ----
# Hot water loop
boiler = Ironbug_BoilerHotWater(dupNum=False)
pumpvariable = Ironbug_PumpVariableSpeed(dupNum=False)
plantbranches = PlantBranches(Branch1=boiler, mapBranchToLoop=False)
plantbranches_2 = PlantBranches(Branch1=duplicate.WaterSide_CoilHeatingWater, mapBranchToLoop=False)
spm_scheduled = Ironbug_SetpointManagerScheduled(Temperature="67", dupNum=False)
hotwaterloop = Ironbug_HotWaterPlantLoop(Supply=[pumpvariable, plantbranches, spm_scheduled], Demand=plantbranches_2, dupNum=False)

noairloop = Ironbug_NoAirLoop(OSZones=thermalzone)
hvacsystem = Ironbug_HVACSystem(AirLoops=flatten(noairloop), PlantLoops=flatten(hotwaterloop))

hvacsystem_2 = ClusterOutput(hvacsystem)
