# Grasshopper definition Sys05_PackagedVAV Reheat.gh (Grasshopper 1.0.7)

# ---- group: Sys05_PackagedVAV Reheat
# Double click the component for more details
sys05 = Sys05()

# ==== cluster Sys05
hbrooms = ClusterInput()  # Honeybee Rooms to which the HVAC system should be assigned.

# ----
# Sys05_PackagedVAV_Reheat
# HBZones
data = Data(flatten(hbrooms))

# ----
# Airloop
lng = ListLength(List=data)
coilhtnwater = Ironbug_CoilHeatingWater(dupNum=False)  # -> AirSide_CoilHeatingWater, WaterSide_CoilHeatingWater
duplicate = Ironbug_Duplicate(Reference=coilhtnwater.AirSide_CoilHeatingWater, Amount=flatten(lng))  # -> Objects, graft(WaterSide_CoilHeatingWater)
objparams = IB_ObjParams(EconomizerControlType="DifferentialDryBulb", DataFieldSetType="Ironbug.HVAC.IB_ControllerOutdoorAir_FieldSet")
objparams_2 = IB_ObjParams(PressureRise="500", DataFieldSetType="Ironbug.HVAC.IB_FanVariableVolume_FieldSet")
oacontroller = Ironbug_OAController(Parameters_=objparams, dupNum=False)
objparams_3 = IB_ObjParams(
    AllOutdoorAirinCooling=Toggle(False),
    AllOutdoorAirinHeating=Toggle(False),
    CentralHeatingDesignSupplyAirTemperature="12.8",
    DataFieldSetType="Ironbug.HVAC.IB_SizingSystem_FieldSet")
vavreheat = Ironbug_AirTerminalSingleDuctVAVReheat(HeatingCoil=duplicate.Objects, dupNum=False)
coilhtnwater_2 = Ironbug_CoilHeatingWater(dupNum=False)  # -> AirSide_CoilHeatingWater, WaterSide_CoilHeatingWater
oasystem = Ironbug_OutdoorAirSystem(Controller_=oacontroller)
thermalzone = Ironbug_ThermalZone(
    HoneybeeZonesOrOsZones=data,
    AirTerminal_=vavreheat,
    IsAirTerminalPriorToZoneEquipments=True,
    allowMultiAirloops=False,
    dupNum=False)
coilclndx2 = Ironbug_CoilCoolingDXTwoSpeed(dupNum=False)
fanvariable = Ironbug_FanVariableVolume(Parameters=objparams_2, dupNum=False)
spm_scheduled = Ironbug_SetpointManagerScheduled(Temperature="12.8", dupNum=False)
airloopbranches = AirLoopBranches(Branch1=thermalzone)
sizingsystem = Ironbug_SizingSystem(Parameters_=objparams_3, dupNum=False)
merge = Merge(Data1=oasystem, Data2=coilclndx2, Data3=coilhtnwater_2.AirSide_CoilHeatingWater, Data4=fanvariable, Data5=spm_scheduled)
airloop = Ironbug_AirLoopHVAC(Supply=merge, Demand=airloopbranches, SizingSystem=sizingsystem, dupNum=False)

# ----
# Hot water loop
boilerhw = Ironbug_BoilerHotWater(dupNum=False)
pumpvariable = Ironbug_PumpVariableSpeed(dupNum=False)
branches = PlantBranches(Branch1=boilerhw, mapBranchToLoop=False)
branches_2 = PlantBranches(B1=duplicate.WaterSide_CoilHeatingWater, B2=coilhtnwater_2.WaterSide_CoilHeatingWater, mapBranchToLoop=False)
spm_scheduled_2 = Ironbug_SetpointManagerScheduled(Temperature="67", dupNum=False)
hwloop = Ironbug_HotWaterPlantLoop(Supply=[pumpvariable, branches, spm_scheduled_2], Demand=branches_2, dupNum=False)

hvacsystem = Ironbug_HVACSystem(AirLoops=flatten(airloop), PlantLoops=flatten(hwloop))

hvacsystem_2 = ClusterOutput(hvacsystem)
