# Grasshopper definition Sys18_GeoThermal + DOAS.gh (Grasshopper 1.0.7)

# ---- group: Sys18_GeoThermal + DOAS
# Double click the component for more details
sys18 = Sys18()

# ==== cluster Sys18
hbrooms = ClusterInput()  # Honeybee Rooms to which the HVAC system should be assigned.
# HBZones
data = Data(flatten(hbrooms))
objparams = IB_ObjParams(
    RatedCoolingCoefficientofPerformance="6.45",
    DataFieldSetType="Ironbug.HVAC.IB_CoilCoolingWaterToAirHeatPumpEquationFit_FieldSet")
objparams_2 = IB_ObjParams(
    RatedHeatingCoefficientofPerformance="4",
    DataFieldSetType="Ironbug.HVAC.IB_CoilHeatingWaterToAirHeatPumpEquationFit_FieldSet")
objparams_3 = IB_ObjParams(FanEfficiency="0.75", MotorEfficiency="0.9", PressureRise="430", DataFieldSetType="Ironbug.HVAC.IB_FanOnOff_FieldSet")
objparams_4 = IB_ObjParams(
    OutdoorAirFlowRateDuringCoolingOperation="0",
    OutdoorAirFlowRateDuringHeatingOperation="0",
    OutdoorAirFlowRateWhenNoCoolingorHeatingisNeeded="0",
    SupplyAirFlowRateWhenNoCoolingorHeatingisNeeded="0",
    DataFieldSetType="Ironbug.HVAC.IB_ZoneHVACWaterToAirHeatPump_FieldSet")
coilhtn_watertoair = Ironbug_CoilCoolingWaterToAirHeatPumpEquationFit(Parameters_=objparams, dupNum=False)  # -> CoilCoolingWaterToAirHeatPumpEquationFit, ToWaterLoop
coilhtn_watertoair_2 = Ironbug_CoilHeatingWaterToAirHeatPumpEquationFit(Parameters_=objparams_2, dupNum=False)  # -> CoilHeatingWaterToAirHeatPumpEquationFit, ToWaterLoop
fanonoff = Ironbug_FanOnOff(Parameters_=objparams_3, dupNum=False)
lng = ListLength(List=data)
duplicate = Ironbug_Duplicate(Reference=coilhtn_watertoair_2.CoilHeatingWaterToAirHeatPumpEquationFit, Amount=lng)  # -> Objects, graft(ToWaterLoop)
duplicate_2 = Ironbug_Duplicate(Reference=coilhtn_watertoair.CoilCoolingWaterToAirHeatPumpEquationFit, Amount=lng)  # -> Objects, graft(ToWaterLoop)
duplicate_3 = Ironbug_Duplicate(Reference=fanonoff, Amount=lng)  # -> Objects, graft(port)
vavnoreheat = Ironbug_AirTerminalSingleDuctVAVNoReheat(dupNum=False)
waterairheatpump = Ironbug_ZoneHVACWaterToAirHeatPump(
    HeatingCoil=duplicate.Objects,
    CoolingCoil=duplicate_2.Objects,
    Fan_=duplicate_3.Objects,
    Parameters_=objparams_4,
    dupNum=False)
duplicate_4 = Ironbug_Duplicate(Reference=vavnoreheat, Amount=lng)  # -> Objects, graft(port)

# ----
# DOAS
thermalzone = Ironbug_ThermalZone(
    HoneybeeZonesOrOsZones=data,
    AirTerminal_=duplicate_4.Objects,
    ZoneEquipment=waterairheatpump,
    IsAirTerminalPriorToZoneEquipments=True,
    allowMultiAirloops=False,
    dupNum=False)
oasystem = Ironbug_OutdoorAirSystem()
coilclndx1 = Ironbug_CoilCoolingDXSingleSpeed(dupNum=False)
coilhtngas = Ironbug_CoilHeatingGas(dupNum=False)
fanvariable = Ironbug_FanVariableVolume(dupNum=False)
spm_scheduled = Ironbug_SetpointManagerScheduled(Temperature="21.1", dupNum=False)
objparams_5 = IB_ObjParams(TypeofLoadtoSizeOn="VentilationRequirement", DataFieldSetType="Ironbug.HVAC.IB_SizingSystem_FieldSet")
airloopbranches = AirLoopBranches(Branch1=thermalzone)
objparams_6 = IB_ObjParams(Name="DOAS", DataFieldSetType="Ironbug.HVAC.IB_AirLoopHVAC_FieldSet")
sizingsystem = Ironbug_SizingSystem(Parameters_=objparams_5, dupNum=False)
merge = Merge(Data1=oasystem, Data2=coilclndx1, Data3=coilhtngas, Data4=fanvariable, Data5=spm_scheduled)
airloop = Ironbug_AirLoopHVAC(Supply=merge, Demand=airloopbranches, SizingSystem=sizingsystem, Parameters_=objparams_6, dupNum=False)

groundhxvertical = Ironbug_GroundHeatExchangerVertical(dupNum=False)

# ----
# Heat Pump Loop
panel = Panel("70")
pipeadiabatic = Ironbug_PipeAdiabatic(dupNum=False)
pipeadiabatic_2 = Ironbug_PipeAdiabatic(dupNum=False)
f2c = Ladybug_F2C(F=panel)  # -> C; plug-in component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
pumpvariable = Ironbug_PumpVariableSpeed(dupNum=False)
plantbranches = PlantBranches(Branch1=groundhxvertical, Branch=pipeadiabatic, mapBranchToLoop=False)
spm_scheduled_2 = Ironbug_SetpointManagerScheduled(Temperature=f2c, dupNum=False)
objparams_7 = IB_ObjParams(Name="Heat Pump Loop", DataFieldSetType="Ironbug.HVAC.IB_PlantLoop_FieldSet")
plantbranches_2 = PlantBranches(B1=duplicate.ToWaterLoop, B2=duplicate_2.ToWaterLoop, B3=pipeadiabatic_2, mapBranchToLoop=False)
merge_2 = Merge(Data1=pumpvariable, Data2=plantbranches, Data3=spm_scheduled_2)
condenserwaterloop = Ironbug_CondenserWaterPlantLoop(Supply=merge_2, Demand=plantbranches_2, Parameters_=objparams_7, dupNum=False)

hvacsystem = Ironbug_HVACSystem(AirLoops=flatten(airloop), PlantLoops=flatten(condenserwaterloop))
hvacsystem_2 = ClusterOutput(hvacsystem)
