# Grasshopper definition FanSystemModel VAV.gh (Grasshopper 1.0.7)
# plug-ins: Ironbug.Grasshopper

# ----
# FanSystemModel VAV
panel = Panel("Continuous")
objparams = IB_ObjParams(
    DesignPressureRise="1017.6",
    FanTotalEfficiency="0.6045",
    MotorEfficiency="0.93",
    Name="Fan VAV",
    SpeedControlMethod=panel,
    DataFieldSetType="Ironbug.HVAC.IB_FanSystemModel_FieldSet")
fansysmodel = IB_FanSystemModel(Parameters_=objparams, dupNum=False)
