# Grasshopper definition Sys00_IdealAirLoad.gh (Grasshopper 0.9.76)

# ---- group: Sys00_Ideal Air Load
# Double click the component for more details
sys00 = Sys00()

# ==== cluster Sys00
hbzones = ClusterInput()

data = Data(flatten(hbzones))
lng = ListLength(List=data)
idealairload = Ironbug_ZoneHVACIdealLoadsAirSystem()
panel = Panel(lng)
duplicate = Ironbug_Duplicate(Reference=idealairload, Amount=panel)  # -> Objects, port
thermalzone = Ironbug_ThermalZone(HoneybeeZonesOrOsZones=data, ZoneEquipment=duplicate.Objects, IsAirTerminalPriorToZoneEquipments=True)
noairloop = Ironbug_NoAirLoop(OSZones=thermalzone)

# ----
# HBZones
hvacsystem = Ironbug_HVACSystem(AirLoops=flatten(noairloop))

hvacsystem_2 = ClusterOutput(hvacsystem)
