# Grasshopper definition 2Rm_VAVReheat.gh (Grasshopper 0.9.76)
# plug-ins: Python Interpreter, Ironbug

# Two rooms with VAV Reheat system
ladybug = Ladybug_Ladybug()  # -> Vviiiiiiiiiizzz; plug-in component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
brep = Brep([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])
mass2zone = Honeybee_Masses2Zones(zoneMasses=flatten(brep), maxRoofAngle=30, createHBZones=Toggle(True))  # -> readMe, HBZones; plug-in component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
panel = Panel(mass2zone.HBZones)
honeybee = Honeybee_Honeybee()  # -> Vviiiiiiiiiizzz; plug-in component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
coilhw = Ironbug_CoilHeatingWater()
boilerhw = Ironbug_BoilerHotWater()
pumpvariable = Ironbug_PumpVariableSpeed()
pumpvariable_2 = Ironbug_PumpVariableSpeed()
boilerhw_2 = Ironbug_BoilerHotWater()
vavreheat = Ironbug_AirTerminalSingleDuctVAVReheat(HeatingCoil=coilhw)
distcooling = Ironbug_DistrictCooling()
coilcw = Ironbug_CoilCoolingWater()
pumpconstant = Ironbug_PumpConstantSpeed()
nickname = Ironbug_DataFields(
    LoopType="Cooling",
    DesignLoopExitTemperature=Slider(10, range=0..10),
    DataFieldSetType="Ironbug.HVAC.IB_SizingPlant_DataFieldSet")
branches = PlantBranches(Branch1=[boilerhw, pumpvariable], Branch2=[boilerhw_2, pumpvariable_2])
spoareset = Ironbug_SetpointManagerOutdoorAirReset(
    SetpointatOutdoorHighTemperature=Slider(50, range=0..100),
    OutdoorHighTemperature=Slider(30, range=0..100),
    SetpointatOutdoorLowTemperature=Slider(80, range=0..100),
    OutdoorLowTemperature=Slider(10, range=0..10))
nickname_2 = Ironbug_OutdoorAirSystem()
coilcw_2 = Ironbug_CoilCoolingWater()
coilhw_2 = Ironbug_CoilHeatingWater()
fanvariable = Ironbug_FanVariableVolume()
toggle = BooleanToggle(False)
thermalzone = Ironbug_ThermalZone(HoneybeeZone=mass2zone.HBZones, AirTerminal_=vavreheat)
branches_2 = PlantBranches(Branch1=coilhw, Branch2=coilhw_2)
sizingzone = Ironbug_SizingZone(Parameters=nickname)
branches_3 = PlantBranches(Branch1=distcooling, Branch2=pumpconstant)
branches_4 = PlantBranches(Branch1=coilcw_2, Branch2=coilcw)
nickname_3 = Ironbug_DataFields(LoopType="Steam", DataFieldSetType="Ironbug.HVAC.IB_SizingPlant_DataFieldSet")
branches_5 = AirLoopBranches(Branch1=thermalzone)
nickname_4 = Ironbug_DataFields(FluidType="Steam", AllAvailableSettings="Name,Hot water loop", DataFieldSetType="Ironbug.HVAC.IB_PlantLoop_DataFieldSet")
sizingzone_2 = Ironbug_SizingZone(Parameters=nickname_3)
plantloop = Ironbug_PlantLoop(Supply=branches_3, Demand=branches_4, SizingLoop=sizingzone)
airloop = Ironbug_AirLoopHVAC(Supply=[nickname_2, coilcw_2, coilhw_2, fanvariable], Demand=branches_5)
plantloop_2 = Ironbug_PlantLoop(Supply=[branches, spoareset], Demand=branches_2, SizingLoop=sizingzone_2, Parameters=nickname_4)
nickname_5 = Ironbug_SaveOSModel(PlantLoops=[plantloop, plantloop_2], AirLoops=airloop, _write=Toggle(False))
panel_2 = Panel(plantloop_2)
panel_3 = Panel(nickname_5)
