# Grasshopper definition 2Rm_VAVReheat_puppet.gh (Grasshopper 0.9.76)
# plug-ins: Python Interpreter, Ironbug

# Two rooms with
# VAV Reheat system
ladybug = Ladybug_Ladybug()  # -> Vviiiiiiiiiizzz; plug-in component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
brep = Brep([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])
number_slider = Slider(85, range=0..100)
coilhw = Ironbug_CoilHeatingWater()
mass2zone = Honeybee_Masses2Zones(zoneMasses=flatten(brep), maxRoofAngle=30, createHBZones=Toggle(True))  # -> readMe, HBZones; plug-in component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
honeybee = Honeybee_Honeybee()  # -> Vviiiiiiiiiizzz; plug-in component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
panel = Panel(mass2zone.HBZones)
nickname = Ironbug_DataFields(RatedInletWaterTemperature=Slider(85.5, range=0..100), DataFieldSetType="Ironbug.HVAC.IB_CoilHeatingWater_DataFieldSet")
coilhw_2 = Ironbug_CoilHeatingWater()
graft = GraftTree(Tree=coilhw, IncludeEmptyLists=True, IncludeNullItems=True)
vavreheat = Ironbug_AirTerminalSingleDuctVAVReheat(HeatingCoil=coilhw_2)
testhvac = TestHVAC()
panel_2 = Panel(coilhw_2)
fanvariable = Ironbug_FanVariableVolume()
thermalzone = Ironbug_ThermalZone(HoneybeeZone=mass2zone.HBZones, AirTerminal_=vavreheat)
branches = PlantBranches(Branch1=coilhw_2)
branches_2 = AirLoopBranches(Branch1=thermalzone)
airloop = Ironbug_AirLoopHVAC(Supply=fanvariable, Demand=branches_2)
hwloop = Ironbug_HotWaterPlantLoop(Demand=branches)
panel_3 = Panel("C:\ladybug\hvacTest.osm")
nickname_2 = Ironbug_SaveOSModel(AirLoops=flatten(airloop), PlantLoops=flatten(hwloop), _write=Toggle(True))
panel_4 = Panel(nickname_2)
