# Grasshopper definition 02_imgList.gh (Grasshopper 0.9.76)
# plug-ins: Archsim, Ironbug

panel = Panel("""C:\Users\Mingbo\Documents\GitHub\HoneybeeCSharp\doc\testFile\AcceleRad_test_IMG_Perspective_CPU@fc.HDR
C:\Users\Mingbo\Documents\GitHub\HoneybeeCSharp\doc\testFile\AcceleRad_test_IMG_Perspective_GPU@fc.HDR""")
panel_2 = Panel("""C:\Colibri\sdd1_Y2.5_Z5.png
C:\Colibri\sdd10_Y6_Z3.png
C:\Colibri\sdd5_Y6_Z5.png""")
number_slider = Slider(440, range=0..1000)
number_slider_2 = Slider(0.5, range=0..1)
panel_3 = Panel("C:\Users\Mingbo\Documents\GitHub\HoneybeeCSharp\doc\testFile\X_4.png")
panel_4 = Panel("C:\Users\Mingbo\Documents\GitHub\HoneybeeCSharp\doc\testFile\indoor_view_h.HDR")
pt = ConstructPoint(XCoordinate=number_slider, YCoordinate=number_slider, ZCoordinate=0)

# ---- group: Extracted Coordinates
pt_2 = Point([Point(440, 440, 0), Point(265, 132, 0), Point(368, 113, 0)])

# ----
viewer = Ladybug_ImageViewer(ImagePath=panel, ViewportScale=1, DisableClickable=True, SaveImgWithCoords=False, scale=1)  # -> ImagePath, ColorValues, AnimatedGIFImage
array_schedule = ArraySchedule(Hours=[1, 1, 1, 1, 1, 1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])
rec = DataRecorder(DataLimit=-10, RecordData=True)
panel_5 = Panel(viewer.ImagePath)
panel_6 = Panel(rec)
clean = CleanTree(RemoveNulls=True, RemoveInvalid=True, RemoveEmpty=True, Tree=panel_6)
panel_7 = Panel(clean)
