# Grasshopper definition HVACSystemWorkflow.gh (Grasshopper 1.0.7)
# plug-ins: Ironbug

brep = Brep([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])
coilhw = Ironbug_CoilHeatingWater()  # -> AirSide_CoilHeatingWater, WaterSide_CoilHeatingWater

objparams = Ironbug_ObjParams(PressureRise="407", DataFieldSetType="Ironbug.HVAC.IB_FanConstantVolume_DataFields")
fanconstant = Ironbug_FanConstantVolume(Parameters=objparams)

intersectmass = IntersectMass(x=brep)  # -> out, A; inputs x: list of Brep
# ---------- intersectmass: C# ----------
    var tolerance = Rhino.RhinoDoc.ActiveDoc.ModelAbsoluteTolerance;
    List<Brep> allOldBreps = x;

    if (x.Count() > 0)
    {
      var results = allOldBreps.AsParallel().AsOrdered().Select(b => SplitBrepWithBreps(b, allOldBreps, tolerance));
      A = results;
    }

    //SplitBrepWithBreps(x[0], x, tolerance);
# ---------- intersectmass: C# additional code ----------
  static Brep SplitBrepWithBreps(Brep CurrentBrep, List<Brep> AllBreps, double tolerance)
  {
    var currentBrep = CurrentBrep;
    var allBreps = AllBreps;

    foreach (Brep item in allBreps)
    {
      var  tempBrep = currentBrep.Split(item, tolerance);
      if (tempBrep.Count() > 0)
      {
        var newBrep = Rhino.Geometry.Brep.JoinBreps(tempBrep, tolerance);

        currentBrep = newBrep.First();
        currentBrep.Faces.ShrinkFaces();
      }
    }
    return currentBrep;

  }
# ---------- end intersectmass ----------
objparams_2 = Ironbug_ObjParams(EconomizerControlType="DifferentialDryBulb", DataFieldSetType="Ironbug.HVAC.IB_ControllerOutdoorAir_DataFieldSet")
honeybee = Honeybee_Honeybee()  # -> Vviiiiiiiiiizzz; plug-in component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
ladybug = Ladybug_Ladybug()  # -> Vviiiiiiiiiizzz; plug-in component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

data = Data()
objparams_3 = Ironbug_ObjParams(EconomizerControlType="DifferentialDryBulb", DataFieldSetType="Ironbug.HVAC.IB_ControllerOutdoorAir_DataFieldSet")
diffuser = Ironbug_AirTerminalSingleDuctUncontrolled()
objparams_4 = Ironbug_ObjParams(PressureRise="500", DataFieldSetType="Ironbug.HVAC.IB_FanConstantVolume_DataFields")
oacontroller = Ironbug_OAController(Parameters=objparams_3)
thermalzone = Ironbug_ThermalZone(HoneybeeZone=data, AirTerminal_=diffuser)
oasystem = Ironbug_OutdoorAirSystem(Controller_=oacontroller)
coilhdxsgl = Ironbug_CoilHeatingDXSingleSpeed()
coilcdxsgl = Ironbug_CoilCoolingDXSingleSpeed()
coilhe = Ironbug_CoilHeatingElectric()
fanconstant_2 = Ironbug_FanConstantVolume(Parameters=objparams_4)
lng = ListLength(List=thermalzone)
graft = GraftTree(Tree=thermalzone, IncludeEmptyLists=True, IncludeNullItems=True)
objparams_5 = Ironbug_ObjParams(
    AllOutdoorAirinCooling=Toggle(False),
    AllOutdoorAirinHeating=Toggle(False),
    CentralHeatingDesignSupplyAirTemperature="40",
    MinimumSystemAirFlowRatio="1",
    DataFieldSetType="Ironbug.HVAC.IB_SizingSystem_FieldSet")
merge = Merge(Data1=oasystem, Data2=coilcdxsgl, Data3=coilhdxsgl, Data4=coilhe, Data5=fanconstant_2)  # -> simplify(Result)
spszreheat = Ironbug_SetpointManagerSingleZoneReheat(ControlZone=graft, MinTemperature="-20", MaxTemperature="100")
duplicate = Ironbug_Duplicate(Reference=merge, Amount=lng)  # -> Objects, port
flip = FlipMatrix(Data=duplicate.Objects)
szsystem = Ironbug_SizingSystem(Parameters=objparams_5)
branches = AirLoopBranches(Branch1=graft)
merge_2 = Merge(Data1=flip, Data2=spszreheat)
airloop = Ironbug_AirLoopHVAC(Supply=merge_2, Demand=branches, SizingSystem=szsystem)
hvacsystem = Ironbug_HVACSystem(AirLoops=flatten(airloop))

number_slider = Slider(0.7, range=0..1)
vavreheat = Ironbug_AirTerminalSingleDuctVAVReheat(HeatingCoil=coilhw.AirSide_CoilHeatingWater)
mass2zone = Honeybee_Masses2Zones(zoneMasses=flatten(intersectmass.A), maxRoofAngle=30, createHBZones=Toggle(True))  # -> readMe, HBZones; plug-in component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
oacontroller_2 = Ironbug_OAController(Parameters=objparams_2)
objparams_6 = Ironbug_ObjParams(PressureRise="500", DataFieldSetType="Ironbug.HVAC.IB_FanVariableVolume_DataFields")
objparams_7 = Ironbug_ObjParams(
    AllOutdoorAirinCooling=Toggle(False),
    AllOutdoorAirinHeating=Toggle(False),
    CentralHeatingDesignSupplyAirTemperature="12.8",
    DataFieldSetType="Ironbug.HVAC.IB_SizingSystem_FieldSet")
panel = Panel("https://www.energyplus.net/weather-download/north_and_central_america_wmo_region_4/USA/NY/USA_NY_New.York-LaGuardia.AP.725030_TMY3/all")
glzparamlist = Honeybee_GlazingParametersList(northGlzParam=0, westGlzParam=0, southGlzParam=number_slider, eastGlzParam=number_slider)  # -> glzParamList; plug-in component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
oasystem_2 = Ironbug_OutdoorAirSystem(Controller_=oacontroller_2)
coilhw_2 = Ironbug_CoilHeatingWater()  # -> AirSide_CoilHeatingWater, WaterSide_CoilHeatingWater
coilcdxtwo = Ironbug_CoilCoolingDXTwoSpeed()
spscheduled = Ironbug_SetpointManagerScheduled(Temperature="12.8")
fanvariable = Ironbug_FanVariableVolume(Parameters=objparams_6)

# ----
# Hot water loop
boilerhw = Ironbug_BoilerHotWater()
pumpvariable = Ironbug_PumpVariableSpeed()
spscheduled_2 = Ironbug_SetpointManagerScheduled(Temperature="67")
branches_2 = PlantBranches(Branch1=boilerhw)
branches_3 = PlantBranches(B1=coilhw.WaterSide_CoilHeatingWater, B2=coilhw_2.WaterSide_CoilHeatingWater)
hwloop = Ironbug_HotWaterPlantLoop(Supply=[pumpvariable, branches_2, spscheduled_2], Demand=branches_3)

szsystem_2 = Ironbug_SizingSystem(Parameters=objparams_7)
solveadjc = Honeybee_SolveAdjacencies(HBZones=flatten(mass2zone.HBZones), removeCurrentAdjc=False, findAdjc=Toggle(True))  # -> readMe, HBZonesWADJ; plug-in component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
glazingcreator = Honeybee_GlazingBasedOnRatio(HBObjects=solveadjc.HBZonesWADJ, glzRatio=glzparamlist, runIt=Toggle(True))  # -> readMe, HBObjWGLZ; plug-in component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
data_2 = Data(flatten(glazingcreator.HBObjWGLZ))
thermalzone_2 = Ironbug_ThermalZone(HoneybeeZone=data_2, AirTerminal_=vavreheat)
branches_4 = AirLoopBranches(Branch1=thermalzone_2)
epw_stat = Ladybug_OpenEPWAndSTATWeatherFiles(weatherFileURL=panel)  # -> epwFile, statFile; plug-in component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
merge_3 = Merge(Data1=oasystem_2, Data2=coilcdxtwo, Data3=coilhw_2.AirSide_CoilHeatingWater, Data4=fanvariable, Data5=spscheduled)
airloop_2 = Ironbug_AirLoopHVAC(Supply=merge_3, Demand=branches_4, SizingSystem=szsystem_2)
hvacsystemslist = Honeybee_HVACSystemsList({"-1. Thermostat Only": -1, "0. Ideal Air Loads": 0, "1. PTAC | Residential": 1, "2. PTHP | Residential": 2, "3. Packaged Single Zone - AC": 3, "4. Packaged Single Zone - HP": 4, "5. Packaged VAV w/ Reheat": 5, "6. Packaged VAV w/ PFP Boxes": 6, "7. VAV w/ Reheat": 7, "8. VAV w/ PFP Boxes": 8, "9. Warm Air Furnace - Gas Fired": 9, "10.Warm Air Furnace - Electric": 10, "11.Fan Coil Units + DOAS": 11, "12.Active Chilled Beams + DOAS": 12, "13.Radiant Floors + DOAS": 13, "14.Custom Rad Surfaces + DOAS": 14, "15.Heated Surfaces + VAV Cooling": 15, "16.VRF + DOAS": 16, "17.WSHP + DOAS": 17}, selected="5. Packaged VAV w/ Reheat")
hvacsystem_2 = Ironbug_HVACSystem(AirLoops=flatten(airloop_2), PlantLoops=flatten(hwloop))
hvacsystem_3 = Honeybee_AssignHVACSystem(HBZones=glazingcreator.HBObjWGLZ, HVACSystems=hvacsystemslist)  # -> readMe, HBZones; plug-in component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
toggle = BooleanToggle(False)  # disabled
toggle_2 = BooleanToggle(False)
toggle_3 = BooleanToggle(False)
panel_2 = Panel("OPS_Sys")  # disabled
exporttoopenstudio = Honeybee_ExportToOpenStudio(epwWeatherFile=epw_stat.epwFile, HBZones=flatten(glazingcreator.HBObjWGLZ), writeOSM=toggle, fileName=panel_2)  # -> readMe, osmFileAddress, idfFileAddress, resultFileAddress, eioFileAddress, rddFileAddress, htmlReport, studyFolder, model; disabled; plug-in component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
exporttoopenstudio_2 = Honeybee_ExportToOpenStudio(
    epwWeatherFile=epw_stat.epwFile,
    HBZones=flatten(hvacsystem_3.HBZones),
    writeOSM=toggle_2,
    runSimulation=toggle_2,
    fileName="HB_Sys")  # -> readMe, osmFileAddress, idfFileAddress, resultFileAddress, eioFileAddress, rddFileAddress, htmlReport, studyFolder, model; plug-in component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
exporttoopenstudio_3 = Honeybee_ExportToOpenStudio(
    epwWeatherFile=epw_stat.epwFile,
    HBZones=flatten(glazingcreator.HBObjWGLZ),
    HVACSystem=flatten(hvacsystem_2),
    writeOSM=toggle_3,
    runSimulation=toggle_3,
    fileName="IB_Sys")  # -> readMe, osmFileAddress, idfFileAddress, resultFileAddress, eioFileAddress, rddFileAddress, htmlReport, studyFolder, model; plug-in component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
readepresult = Honeybee_ReadEPResult(resultFileAddress=exporttoopenstudio_2.resultFileAddress)  # -> totalThermalLoad, thermalLoadBalance, cooling, heating, electricLight, electricEquip, fanElectric, pumpElectric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; plug-in component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
c_script = CSharpScript(x=exporttoopenstudio.osmFileAddress, Reference="C:\openstudio-2.5.0\CSharp\openstudio\OpenStudio.dll")  # -> out, A; inputs x: String; disabled
# ---------- c_script: C# ----------
    if (string.IsNullOrEmpty(x))
    {
      return;
    }

    var p = new OpenStudio.Path(x);
    var m_o = OpenStudio.Model.load(p);
    Print(m_o.is_initialized().ToString());
    var m = m_o.get();
    var zs = m.getThermalZones();
    foreach (OpenStudio.ThermalZone z in zs)
    {
      
      var eqps = z.equipment();
      foreach (var e in eqps)
      {
		 e.remove();
      }
    }
    OpenStudio.OpenStudioModelHVAC.addSystemType1(m, zs);

    m.save(p, true);
# ---------- end c_script ----------
panel_3 = Panel(exporttoopenstudio_3.osmFileAddress)
readepresult_2 = Honeybee_ReadEPResult(resultFileAddress=exporttoopenstudio_3.resultFileAddress)  # -> totalThermalLoad, thermalLoadBalance, cooling, heating, electricLight, electricEquip, fanElectric, pumpElectric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; plug-in component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
panel_4 = Panel(exporttoopenstudio.osmFileAddress)  # disabled
panel_5 = Panel(c_script.out)  # disabled
strnum = Ladybug_SeparateData(inputList=flatten(readepresult.cooling))  # -> numbers, strings; plug-in component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
strnum_2 = Ladybug_SeparateData(inputList=flatten(readepresult.heating))  # -> numbers, strings; plug-in component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
strnum_3 = Ladybug_SeparateData(inputList=flatten(readepresult_2.cooling))  # -> numbers, strings; plug-in component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
strnum_4 = Ladybug_SeparateData(inputList=flatten(readepresult_2.heating))  # -> numbers, strings; plug-in component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
ma = MassAddition(Input=strnum.numbers)  # -> Result, PartialResults
ma_2 = MassAddition(Input=strnum_2.numbers)  # -> Result, PartialResults
ma_3 = MassAddition(Input=strnum_3.numbers)  # -> Result, PartialResults
ma_4 = MassAddition(Input=strnum_4.numbers)  # -> Result, PartialResults
panel_6 = Panel(ma_2.Result)
panel_7 = Panel(ma.Result)
panel_10 = Panel(ma_3.Result)
panel_11 = Panel(ma_4.Result)

panel_12 = Panel("""1
0
0
0
0
0""")
cvbiquadratic = Ironbug_CurveBiquadratic(Coefficients=panel_12)
objparams_8 = Ironbug_ObjParams(
    EfficiencyCurveTemperatureEvaluationVariable="LeavingBoiler",
    NormalizedBoilerEfficiencyCurve=cvbiquadratic,
    DataFieldSetType="Ironbug.HVAC.IB_BoilerHotWater_DataFields")

objparams_9 = Ironbug_ObjParams(PressureRise="300", DataFieldSetType="Ironbug.HVAC.IB_FanConstantVolume_DataFields")
fanconstant_3 = Ironbug_FanConstantVolume(Parameters=objparams_9)

timer = Timer(TimerInterval=1000)
list = ValueList({"One": 1, "Two": 2, "Three": 2² - 1, "Four": Sqrt(16)}, selected="One")
knob = ControlKnob(Decimals=2, Limit=True, Maximum=10, Minimum=0, Range=1, Value=1.03)
digit_scroller = DigitScroller(Scroller_Digits=12, Scroller_Radix=9, Scroller_Value=0.25)
item = CherryPicker(ListIndex=0)
gradient = Gradient(LowerLimit=0, UpperLimit=1, stops=[0.15: RGB(255, 130, 160), 0.85: RGB(220, 0, 40)])
dam = DataDam(BufferDelay=10000000, BufferMode=0)
nblur = BlurNumbers(Strength=0.5, Iterations=1, Lock=True, Wrap=False)
hvactemplate = Ironbug_HVACTemplate(_run=Button())
list_2 = ValueList({"One": 1, "Two": 2, "Three": 2² - 1, "Four": Sqrt(16)}, selected="One")

# ----
# PTAC
coilhw_3 = Ironbug_CoilHeatingWater()  # -> AirSide_CoilHeatingWater, WaterSide_CoilHeatingWater
ptac = Ironbug_ZoneHVACPackagedTerminalAirConditioner(HeatingCoil=coilhw_3.AirSide_CoilHeatingWater, Fan_=fanconstant)

# ----
# HBZones
data_3 = Data(flatten(glazingcreator.HBObjWGLZ))

lng_2 = ListLength(List=data_3)
thermalzone_3 = Ironbug_ThermalZone(HoneybeeZone=data_3, ZoneEquipments=ptac)

noairloop = Ironbug_NoAirLoop(OSZones=thermalzone_3)

lng_3 = ListLength(List=flatten(noairloop))
lng_4 = ListLength(List=flatten(thermalzone_3))
rec = DataRecorder(lng_3, DataLimit=-10, RecordData=True)
rec_2 = DataRecorder(lng_4, DataLimit=-10, RecordData=True)
panel_13 = Panel(rec)
panel_14 = Panel(rec_2)

# ----
# Hot water loop
boilerhw_2 = Ironbug_BoilerHotWater()
pumpvariable_2 = Ironbug_PumpVariableSpeed()
branches_5 = PlantBranches(Branch1=boilerhw_2)
branches_6 = PlantBranches(Branch1=coilhw_3.WaterSide_CoilHeatingWater)

spscheduled_3 = Ironbug_SetpointManagerScheduled(Temperature="67")

hwloop_2 = Ironbug_HotWaterPlantLoop(Supply=[pumpvariable_2, branches_5, spscheduled_3], Demand=branches_6)

hvacsystem_4 = Ironbug_HVACSystem(AirLoops=flatten(noairloop), PlantLoops=flatten(hwloop_2))

lng_5 = ListLength(List=hvacsystem_4)
lng_6 = ListLength(List=branches_6)
dam_2 = DataDam(DataA=hvacsystem_4, BufferDelay=10000000, BufferMode=0)  # disabled
rec_3 = DataRecorder(lng_5, DataLimit=-10, RecordData=True)
rec_4 = DataRecorder(lng_6, DataLimit=-10, RecordData=True)
panel_15 = Panel(rec_3)
rec_5 = DataRecorder(dam_2, DataLimit=-10, RecordData=True)  # disabled
panel_16 = Panel(rec_4)
panel_17 = Panel(rec_5)  # disabled

# ----
# PTHP
pthp = Ironbug_ZoneHVACPackagedTerminalHeatPump()

# ----
# HBZones
data_4 = Data()

thermalzone_4 = Ironbug_ThermalZone(HoneybeeZone=data_4, ZoneEquipments=pthp)
noairloop_2 = Ironbug_NoAirLoop(OSZones=thermalzone_4)

hvacsystem_5 = Ironbug_HVACSystem(AirLoops=flatten(noairloop_2))
