# Grasshopper definition TestGenerator.gh (Grasshopper 1.0.7)
# plug-ins: Ironbug.Grasshopper

number_slider = Slider(10, range=0..10)
number_slider_2 = Slider(5, range=0..10)
domain_box = DomainBox(Base=PlaneXY(0, 0, 0), X=number_slider, Y=number_slider, Z=number_slider_2)
Y = UnitY(Factor=number_slider)
move = Move(Geometry=domain_box, Motion=Y)  # -> Geometry, Transform
merge = Merge(Data1=domain_box, Data2=move.Geometry)
Z = UnitZ(Factor=number_slider_2)
move_2 = Move(Geometry=merge, Motion=Z)  # -> Geometry, Transform
merge_2 = Merge(Data1=merge, Data2=move_2.Geometry)
roomsolid = HBRoomFromSolid(geo=flatten(merge_2), conditioned=True)  # -> report, rooms; plug-in component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
panel = Panel("""Sys01_PTAC_AllElec
Sys01_PTAC_Boiler
Sys02_PTHP_Advanced
Sys03_SZAC_GasCoil
Sys04_SZHP_All_Elec
Sys05_PVAV Gas Boiler Reheat""")
all_air = HBAllAirHVACTemplates({"VAV chiller with gas boiler reheat": "VAV_Chiller_Boiler", "VAV chiller with central air source heat pump reheat": "VAV_Chiller_ASHP", "VAV chiller with district hot water reheat": "VAV_Chiller_DHW", "VAV chiller with PFP boxes": "VAV_Chiller_PFP", "VAV chiller with gas coil reheat": "VAV_Chiller_GasCoil", "VAV air-cooled chiller with gas boiler reheat": "VAV_ACChiller_Boiler", "VAV air-cooled chiller with central air source heat pump reheat": "VAV_ACChiller_ASHP", "VAV air-cooled chiller with district hot water reheat": "VAV_ACChiller_DHW", "VAV air-cooled chiller with PFP boxes": "VAV_ACChiller_PFP", "VAV air-cooled chiller with gas coil reheat": "VAV_ACChiller_GasCoil"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}, selected="PTHP")
hvactemplate = IB_HVACTemplate()
solveadj = HBSolveAdjacency(rooms=flatten(roomsolid.rooms), run=Toggle(True))  # -> report, adj_rooms; plug-in component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
rooms = Data(solveadj.adj_rooms)

# ---- group: Sys03_SZAC_GasCoil
# Double click the component for more details
cluster = Cluster_4(rooms=rooms)

# ---- group: Sys01_PTAC_AllElec
# Double click the component for more details
cluster_2 = Cluster(rooms=rooms)

# ---- group: Sys01_PTAC_Boiler
# Double click the component for more details
cluster_3 = Cluster_2(rooms=rooms)

# ---- group: Sys02_PTHP_Advanced
# Double click the component for more details
cluster_4 = Cluster_3(rooms=rooms)

# ---- group: Sys05_PackagedVAV Gas Boiler Reheat
# Double click the component for more details
cluster_5 = Cluster_6(rooms=rooms)

# ----
int = Integer(Slider(0, range=0..10))

# ---- group: Sys04_SZHP_All_Elec
# Double click the component for more details
cluster_6 = Cluster_5(rooms=rooms)

# ----
item = ListItem(List=panel, Index=int, Wrap=True)
panel_2 = Panel(item)
allairhvac = HBAllAirHVAC(rooms=flatten(solveadj.adj_rooms), system_type=all_air)  # -> report, rooms; plug-in component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
merge_3 = Merge(Data1=cluster_2, Data2=cluster_3, Data3=cluster_4, Data4=cluster, Data5=cluster_6, Data6=cluster_5)
model = HBModel(rooms=flatten(solveadj.adj_rooms))  # -> report, model; plug-in component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
file_path = FilePath("C:\Program Files\ladybug_tools\resources\weather\CHN_SH_Shanghai-Hongqiao.Intl.AP.583670_TMYx.2004-2018\CHN_SH_Shanghai-Hongqiao.Intl.AP.583670_TMYx.2004-2018.epw")
concat = Concatenate(FragmentC="D:\Dev\Ironbug\src\Ironbug.HVAC_Tests\TestSource\", FragmentA=panel_2, FragmentB=".json")
item_2 = ListItem(List=merge_3, Index=int, Wrap=True)
panel_3 = Panel(all_air)
button = Button()
modeltoosm = HBModelToOSM(model=model.model, epw_file=file_path, write=Toggle(True), run="2")  # -> report, jsons, osw, osm, idf, sql, zsz, rdd, html; plug-in component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
panel_4 = Panel(item)
hvac = Data(item_2)
savetojson = IB_SaveToJson(NewFilePath=concat, HVACSystem=item_2, _write=Toggle(False))
panel_5 = Panel(modeltoosm.osm)
savetofile = IB_SaveToFile(NewFilePath=modeltoosm.osm, HVACSystem=hvac, _write=Toggle(True), OverrideMode=False, writeMode=0)
boolean_toggle = BooleanToggle(False)
runosm = HBRunOSM(osm=savetofile, epw_file=file_path, translate=boolean_toggle, run=boolean_toggle)  # -> out, idf, sql, zsz, rdd, html; plug-in component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
panel_6 = Panel(savetofile)
eui = HBEndUseIntensity(sql=runosm.sql)  # -> eui, eui_end_use, end_uses, gross_floor; plug-in component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
panel_7 = Panel(eui.eui)

# ==== cluster Cluster
rooms = ClusterInput()

# ----
# Cooling Coil Performance Curves
panel = Panel("1")
objparams = IB_ObjParams(
    MaximumCurveOutput=panel,
    MaximumValueofx=panel,
    MinimumCurveOutput="0.7",
    MinimumValueofx="0",
    DataFieldSetType="Ironbug.HVAC.Curves.IB_CurveQuadratic_FieldSet")
panel_2 = Panel("""0.342414409
0.034885008
-0.0006237
0.004977216
0.000437951
-0.000728028""")
objparams_2 = IB_ObjParams(MaximumValueofx="1.5", MinimumValueofx="0.5", DataFieldSetType="Ironbug.HVAC.Curves.IB_CurveQuadratic_FieldSet")
panel_3 = Panel("""1.1552
-0.1808
0.0256""")
objparams_3 = IB_ObjParams(
    MaximumValueofx="23.89",
    MaximumValueofy="46.11",
    MinimumValueofx="12.78",
    MinimumValueofy="23.89",
    DataFieldSetType="Ironbug.HVAC.Curves.IB_CurveBiquadratic_FieldSet")
panel_4 = Panel("""0.85
0.15
0""")
curvequadratic = IB_CurveQuadratic(Coefficients=panel_3, Parameters_=objparams_2, dupNum=False)
curvebiquadratic = IB_CurveBiquadratic(Coefficients=panel_2, Parameters_=objparams_3, dupNum=False)
curvequadratic_2 = IB_CurveQuadratic(Coefficients=panel_4, Parameters_=objparams, dupNum=False)
objparams_4 = IB_ObjParams(MaximumValueofx="1.5", MinimumValueofx="0.5", DataFieldSetType="Ironbug.HVAC.Curves.IB_CurveQuadratic_FieldSet")
panel_5 = Panel("""0.942587793
0.009543347
0.00068377
-0.011042676
0.000005249
-0.00000972""")
panel_6 = Panel("""0.8
0.2
0""")
objparams_5 = IB_ObjParams(
    MaximumValueofx="23.89",
    MaximumValueofy="46.11",
    MinimumValueofx="12.78",
    MinimumValueofy="23.89",
    DataFieldSetType="Ironbug.HVAC.Curves.IB_CurveBiquadratic_FieldSet")
curvequadratic_3 = IB_CurveQuadratic(Coefficients=panel_6, Parameters_=objparams_4, dupNum=False)
curvebiquadratic_2 = IB_CurveBiquadratic(Coefficients=panel_5, Parameters_=objparams_5, dupNum=False)
objparams_6 = IB_ObjParams(
    EnergyInputRatioFunctionOfFlowFractionCurve=curvequadratic,
    EnergyInputRatioFunctionOfTemperatureCurve=curvebiquadratic,
    PartLoadFractionCorrelationCurve=curvequadratic_2,
    TotalCoolingCapacityFunctionOfFlowFractionCurve=curvequadratic_3,
    TotalCoolingCapacityFunctionOfTemperatureCurve=curvebiquadratic_2,
    DataFieldSetType="Ironbug.HVAC.IB_CoilCoolingDXSingleSpeed_FieldSet")

coilclndx1 = IB_CoilCoolingDXSingleSpeed(Parameters_=objparams_6, dupNum=False)

# ----
# HBRooms
# PTAC
rooms_2 = Data(flatten(rooms))

lng = ListLength(List=rooms_2)
panel_7 = Panel(lng)
objparams_7 = IB_ObjParams(FanEfficiency="0.52", PressureRise="331", DataFieldSetType="Ironbug.HVAC.IB_FanOnOff_FieldSet")
objparams_8 = IB_ObjParams(ZoneHeatingDesignSupplyAirTemperature="50", DataFieldSetType="Ironbug.HVAC.IB_SizingZone_FieldSet")
fanonoff = IB_FanOnOff(Parameters_=objparams_7, dupNum=False)
sizingzone = IB_SizingZone(Parameters_=objparams_8, dupNum=False)

coilhtnelec = IB_CoilHeatingElectric(DuplicateNumber_=panel_7, dupNum=True)

ptac = Ironbug_ZoneHVACPackagedTerminalAirConditioner(HeatingCoil=coilhtnelec, CoolingCoil=coilclndx1, Fan_=fanonoff, dupNum=False)
thermalzone = Ironbug_ThermalZone(
    HoneybeeZonesOrOsZones=rooms_2,
    ZoneEquipment=ptac,
    SizingZone=sizingzone,
    IsAirTerminalPriorToZoneEquipments=True,
    dupNum=False)

noairloop = Ironbug_NoAirLoop(OSZones=thermalzone)
hvacsystem = Ironbug_HVACSystem(AirLoops=flatten(noairloop))

hvacsystem_2 = ClusterOutput(hvacsystem)

# ==== cluster Cluster_2
rooms = ClusterInput()

# ----
# Cooling Coil Performance Curves
panel = Panel("1")
objparams = IB_ObjParams(
    MaximumCurveOutput=panel,
    MaximumValueofx=panel,
    MinimumCurveOutput="0.7",
    MinimumValueofx="0",
    DataFieldSetType="Ironbug.HVAC.Curves.IB_CurveQuadratic_FieldSet")
panel_2 = Panel("""0.342414409
0.034885008
-0.0006237
0.004977216
0.000437951
-0.000728028""")
objparams_2 = IB_ObjParams(MaximumValueofx="1.5", MinimumValueofx="0.5", DataFieldSetType="Ironbug.HVAC.Curves.IB_CurveQuadratic_FieldSet")
panel_3 = Panel("""1.1552
-0.1808
0.0256""")
objparams_3 = IB_ObjParams(
    MaximumValueofx="23.89",
    MaximumValueofy="46.11",
    MinimumValueofx="12.78",
    MinimumValueofy="23.89",
    DataFieldSetType="Ironbug.HVAC.Curves.IB_CurveBiquadratic_FieldSet")
panel_4 = Panel("""0.85
0.15
0""")
curvequadratic = IB_CurveQuadratic(Coefficients=panel_3, Parameters_=objparams_2, dupNum=False)
curvebiquadratic = IB_CurveBiquadratic(Coefficients=panel_2, Parameters_=objparams_3, dupNum=False)
curvequadratic_2 = IB_CurveQuadratic(Coefficients=panel_4, Parameters_=objparams, dupNum=False)
objparams_4 = IB_ObjParams(MaximumValueofx="1.5", MinimumValueofx="0.5", DataFieldSetType="Ironbug.HVAC.Curves.IB_CurveQuadratic_FieldSet")
panel_5 = Panel("""0.942587793
0.009543347
0.00068377
-0.011042676
0.000005249
-0.00000972""")
panel_6 = Panel("""0.8
0.2
0""")
objparams_5 = IB_ObjParams(
    MaximumValueofx="23.89",
    MaximumValueofy="46.11",
    MinimumValueofx="12.78",
    MinimumValueofy="23.89",
    DataFieldSetType="Ironbug.HVAC.Curves.IB_CurveBiquadratic_FieldSet")
curvequadratic_3 = IB_CurveQuadratic(Coefficients=panel_6, Parameters_=objparams_4, dupNum=False)
curvebiquadratic_2 = IB_CurveBiquadratic(Coefficients=panel_5, Parameters_=objparams_5, dupNum=False)
objparams_6 = IB_ObjParams(
    EnergyInputRatioFunctionOfFlowFractionCurve=curvequadratic,
    EnergyInputRatioFunctionOfTemperatureCurve=curvebiquadratic,
    PartLoadFractionCorrelationCurve=curvequadratic_2,
    TotalCoolingCapacityFunctionOfFlowFractionCurve=curvequadratic_3,
    TotalCoolingCapacityFunctionOfTemperatureCurve=curvebiquadratic_2,
    DataFieldSetType="Ironbug.HVAC.IB_CoilCoolingDXSingleSpeed_FieldSet")

objparams_7 = IB_ObjParams(
    BoilerFlowMode="LeavingSetpointModulated",
    MaximumPartLoadRatio="1.2",
    NominalThermalEfficiency="0.78",
    DataFieldSetType="Ironbug.HVAC.IB_BoilerHotWater_FieldSet")
coilclndx1 = IB_CoilCoolingDXSingleSpeed(Parameters_=objparams_6, dupNum=False)

# ----
# HBRooms
# PTAC
rooms_2 = Data(flatten(rooms))

lng = ListLength(List=rooms_2)
panel_7 = Panel(lng)
objparams_8 = IB_ObjParams(FanEfficiency="0.52", PressureRise="331", DataFieldSetType="Ironbug.HVAC.IB_FanOnOff_FieldSet")
objparams_9 = IB_ObjParams(ZoneHeatingDesignSupplyAirTemperature="50", DataFieldSetType="Ironbug.HVAC.IB_SizingZone_FieldSet")
coilhtnwater = Ironbug_CoilHeatingWater(DuplicateNumber_=panel_7, dupNum=True)  # -> AirSide_CoilHeatingWater, graft(WaterSide_CoilHeatingWater)
fanonoff = IB_FanOnOff(Parameters_=objparams_8, dupNum=False)
ptac = Ironbug_ZoneHVACPackagedTerminalAirConditioner(HeatingCoil=coilhtnwater.AirSide_CoilHeatingWater, CoolingCoil=coilclndx1, Fan_=fanonoff, dupNum=False)
sizingzone = IB_SizingZone(Parameters_=objparams_9, dupNum=False)
thermalzone = Ironbug_ThermalZone(
    HoneybeeZonesOrOsZones=rooms_2,
    ZoneEquipment=ptac,
    SizingZone=sizingzone,
    IsAirTerminalPriorToZoneEquipments=True,
    dupNum=False)

# ----
# Hot water loop
panel_8 = Panel("82.2")
boiler = Ironbug_BoilerHotWater(Parameters_=objparams_7, dupNum=False)
objparams_10 = IB_ObjParams(DesignLoopExitTemperature=panel_8, DataFieldSetType="Ironbug.HVAC.IB_SizingPlant_FieldSet")
pumpvariable = Ironbug_PumpVariableSpeed(dupNum=False)
plantbranches = PlantBranches(Branch1=boiler, mapBranchToLoop=False)
plantbranches_2 = PlantBranches(Branch1=coilhtnwater.WaterSide_CoilHeatingWater, mapBranchToLoop=False)
spm_scheduled = Ironbug_SetpointManagerScheduled(Temperature=panel_8, dupNum=False)
sizingplant = IB_SizingPlant(Parameters_=objparams_10, dupNum=False)
hotwaterloop = Ironbug_HotWaterPlantLoop(Supply=[pumpvariable, plantbranches, spm_scheduled], Demand=plantbranches_2, SizingLoop=sizingplant, dupNum=False)

noairloop = Ironbug_NoAirLoop(OSZones=thermalzone)
hvacsystem = Ironbug_HVACSystem(AirLoops=flatten(noairloop), PlantLoops=flatten(hotwaterloop))

hvacsystem_2 = ClusterOutput(hvacsystem)

# ==== cluster Cluster_3
rooms = ClusterInput()

# ----
# Heating Coil Performance Curves
panel = Panel("-20")
objparams = IB_ObjParams(MaximumValueofx="20", MinimumValueofx=panel, DataFieldSetType="Ironbug.HVAC.Curves.IB_CurveCubic_FieldSet")
objparams_2 = IB_ObjParams(MaximumValueofx="1.5", MinimumValueofx="0.5", DataFieldSetType="Ironbug.HVAC.Curves.IB_CurveCubic_FieldSet")
objparams_3 = IB_ObjParams(MaximumValueofx="20", MinimumValueofx="-20", DataFieldSetType="Ironbug.HVAC.Curves.IB_CurveCubic_FieldSet")
panel_2 = Panel("""1.19248
-0.0300438
0.00103745
-0.000023328""")
panel_3 = Panel("""0.84
0.16
0.0
0.0""")
panel_4 = Panel("""0.758746
0.027626
0.000148716
0.0000034992""")
panel_5 = Panel("""1.3824
-0.4336
0.0512""")
panel_6 = Panel("""0.85
0.15
0""")
curvequadratic = IB_CurveQuadratic(Coefficients=panel_5, dupNum=False)
curvecubic = IB_CurveCubic(Coefficients=panel_2, Parameters_=objparams, dupNum=False)
curvequadratic_2 = IB_CurveQuadratic(Coefficients=panel_6, dupNum=False)
curvecubic_2 = IB_CurveCubic(Coefficients=panel_3, Parameters_=objparams_2, dupNum=False)
curvecubic_3 = IB_CurveCubic(Coefficients=panel_4, Parameters_=objparams_3, dupNum=False)
panel_7 = Panel(""" 0.297145
0.0430933
-0.000748766
0.00597727
0.000482112
-0.000956448""")
objparams_4 = IB_ObjParams(
    MaximumValueofx="29.44",
    MaximumValueofy="29.44",
    MinimumValueofx="-23.33",
    MinimumValueofy="-23.33",
    DataFieldSetType="Ironbug.HVAC.Curves.IB_CurveBiquadratic_FieldSet")
curvebiquadratic = IB_CurveBiquadratic(Coefficients=panel_7, Parameters_=objparams_4, dupNum=False)
objparams_5 = IB_ObjParams(
    DefrostControl="OnDemand",
    DefrostEnergyInputRatioFunctionofTemperatureCurve=curvebiquadratic,
    DefrostStrategy="ReverseCycle",
    EnergyInputRatioFunctionofFlowFractionCurve=curvequadratic,
    EnergyInputRatioFunctionofTemperatureCurve=curvecubic,
    PartLoadFractionCorrelationCurve=curvequadratic_2,
    RatedCOP="3.3",
    TotalHeatingCapacityFunctionofFlowFractionCurve=curvecubic_2,
    TotalHeatingCapacityFunctionofTemperatureCurve=curvecubic_3,
    DataFieldSetType="Ironbug.HVAC.IB_CoilHeatingDXSingleSpeed_FieldSet")

# ----
# Cooling Coil Performance Curves
# For Heat Pump
panel_8 = Panel("1.5")
panel_9 = Panel("""0.297145
0.0430933
-0.000748766
0.00597727
0.000482112
-0.000956448""")
objparams_6 = IB_ObjParams(MaximumValueofx=panel_8, MinimumValueofx="0.5", DataFieldSetType="Ironbug.HVAC.Curves.IB_CurveQuadratic_FieldSet")
objparams_7 = IB_ObjParams(MaximumValueofx="1", MinimumValueofx="0", DataFieldSetType="Ironbug.HVAC.Curves.IB_CurveQuadratic_FieldSet")
panel_10 = Panel("""1.156
-0.1816
0.0256""")
objparams_8 = IB_ObjParams(
    MaximumValueofx="23.89",
    MaximumValueofy="46.11",
    MinimumValueofx="12.78",
    MinimumValueofy="21.1",
    DataFieldSetType="Ironbug.HVAC.Curves.IB_CurveBiquadratic_FieldSet")
panel_11 = Panel("""0.85
0.15
0""")
curvequadratic_3 = IB_CurveQuadratic(Coefficients=panel_10, Parameters_=objparams_6, dupNum=False)
curvebiquadratic_2 = IB_CurveBiquadratic(Coefficients=panel_9, Parameters_=objparams_8, dupNum=False)
curvequadratic_4 = IB_CurveQuadratic(Coefficients=panel_11, Parameters_=objparams_7, dupNum=False)
objparams_9 = IB_ObjParams(MaximumValueofx="1.5", MinimumValueofx="0.5", DataFieldSetType="Ironbug.HVAC.Curves.IB_CurveQuadratic_FieldSet")
panel_12 = Panel("""0.766956
0.0107756
-0.0000414703
0.00134961
-0.000261144
0.000457488""")
panel_13 = Panel("""0.8
0.2
0""")
objparams_10 = IB_ObjParams(
    MaximumValueofx="23.89",
    MaximumValueofy="46.11",
    MinimumValueofx="12.78",
    MinimumValueofy="21.1",
    DataFieldSetType="Ironbug.HVAC.Curves.IB_CurveBiquadratic_FieldSet")
curvequadratic_5 = IB_CurveQuadratic(Coefficients=panel_13, Parameters_=objparams_9, dupNum=False)
curvebiquadratic_3 = IB_CurveBiquadratic(Coefficients=panel_12, Parameters_=objparams_10, dupNum=False)
objparams_11 = IB_ObjParams(
    EnergyInputRatioFunctionOfFlowFractionCurve=curvequadratic_3,
    EnergyInputRatioFunctionOfTemperatureCurve=curvebiquadratic_2,
    PartLoadFractionCorrelationCurve=curvequadratic_4,
    TotalCoolingCapacityFunctionOfFlowFractionCurve=curvequadratic_5,
    TotalCoolingCapacityFunctionOfTemperatureCurve=curvebiquadratic_3,
    DataFieldSetType="Ironbug.HVAC.IB_CoilCoolingDXSingleSpeed_FieldSet")

coilclndx1 = IB_CoilCoolingDXSingleSpeed(Parameters_=objparams_11, dupNum=False)

# ----
# HBRooms
# PTHP
rooms_2 = Data(flatten(rooms))

lng = ListLength(List=rooms_2)
objparams_12 = IB_ObjParams(FanEfficiency="0.52", PressureRise="331", DataFieldSetType="Ironbug.HVAC.IB_FanOnOff_FieldSet")
panel_14 = Panel(lng)
objparams_13 = IB_ObjParams(
    ZoneCoolingDesignSupplyAirTemperature="13.8",
    ZoneHeatingDesignSupplyAirTemperature="50",
    DataFieldSetType="Ironbug.HVAC.IB_SizingZone_FieldSet")
coilhtn_dx1 = IB_CoilHeatingDXSingleSpeed(Parameters_=objparams_5, dupNum=False)
fanonoff = IB_FanOnOff(Parameters_=objparams_12, dupNum=False)
sizingzone = IB_SizingZone(Parameters_=objparams_13, dupNum=False)

pt_heatpump = Ironbug_ZoneHVACPackagedTerminalHeatPump(HeatingCoil=coilhtn_dx1, CoolingCoil=coilclndx1, Fan_=fanonoff, dupNum=False)

duplicate = Ironbug_Duplicate(Reference=pt_heatpump, Amount=panel_14)  # -> Objects, port
thermalzone = Ironbug_ThermalZone(
    HoneybeeZonesOrOsZones=rooms_2,
    ZoneEquipment=duplicate.Objects,
    SizingZone=sizingzone,
    IsAirTerminalPriorToZoneEquipments=True,
    dupNum=False)

noairloop = Ironbug_NoAirLoop(OSZones=thermalzone)
hvacsystem = Ironbug_HVACSystem(AirLoops=flatten(noairloop))

hvacsystem_2 = ClusterOutput(hvacsystem)

# ==== cluster Cluster_4
rooms = ClusterInput()

# ----
# Cooling Coil Performance Curves
# For PSZ-AC
panel = Panel("1")
objparams = IB_ObjParams(
    MaximumCurveOutput=panel,
    MaximumValueofx=panel,
    MinimumCurveOutput="0.7",
    MinimumValueofx="0",
    DataFieldSetType="Ironbug.HVAC.Curves.IB_CurveQuadratic_FieldSet")
panel_2 = Panel("""0.28687133
0.023902164
-0.000810648
0.013458546
0.0003389364
-0.0004870044""")
panel_3 = Panel("""0.90949556
0.09864773
-0.00819488""")
objparams_2 = IB_ObjParams(
    MaximumValueofx="100",
    MaximumValueofy="100",
    MinimumValueofx="-100",
    MinimumValueofy="-100",
    DataFieldSetType="Ironbug.HVAC.Curves.IB_CurveBiquadratic_FieldSet")
curvebiquadratic = IB_CurveBiquadratic(Coefficients=panel_2, Parameters_=objparams_2, dupNum=False)
curvequadratic = IB_CurveQuadratic(Coefficients=panel_3, Parameters_=objparams, dupNum=False)
objparams_3 = IB_ObjParams(MaximumValueofx="100", MinimumValueofx="-100", DataFieldSetType="Ironbug.HVAC.Curves.IB_CurveQuadratic_FieldSet")
panel_4 = Panel("""0.9712123
-0.015275502
0.0014434524
-0.00039321
-0.0000068364
-0.0002905956""")
panel_5 = Panel("""1
0
0""")
objparams_4 = IB_ObjParams(
    MaximumValueofx="100",
    MaximumValueofy="100",
    MinimumValueofx="-100",
    MinimumValueofy="-100",
    DataFieldSetType="Ironbug.HVAC.Curves.IB_CurveBiquadratic_FieldSet")
curvequadratic_2 = IB_CurveQuadratic(Coefficients=panel_5, Parameters_=objparams_3, dupNum=False)
curvebiquadratic_2 = IB_CurveBiquadratic(Coefficients=panel_4, Parameters_=objparams_4, dupNum=False)
objparams_5 = IB_ObjParams(
    EnergyInputRatioFunctionOfFlowFractionCurve=curvequadratic_2,
    EnergyInputRatioFunctionOfTemperatureCurve=curvebiquadratic,
    PartLoadFractionCorrelationCurve=curvequadratic,
    TotalCoolingCapacityFunctionOfFlowFractionCurve=curvequadratic_2,
    TotalCoolingCapacityFunctionOfTemperatureCurve=curvebiquadratic_2,
    DataFieldSetType="Ironbug.HVAC.IB_CoilCoolingDXSingleSpeed_FieldSet")

supply_air_cooling_temperature = Panel("12.78")
supply_air_heating_temperature = Panel("50")

objparams_6 = IB_ObjParams(
    ZoneCoolingDesignSupplyAirTemperature=supply_air_cooling_temperature,
    ZoneHeatingDesignSupplyAirTemperature=supply_air_heating_temperature,
    DataFieldSetType="Ironbug.HVAC.IB_SizingZone_FieldSet")
coilclndx1 = IB_CoilCoolingDXSingleSpeed(Parameters_=objparams_5, dupNum=False)
coilhtngas = Ironbug_CoilHeatingGas(dupNum=False)
objparams_7 = IB_ObjParams(NightCycleControlType="CycleOnAny", DataFieldSetType="Ironbug.HVAC.IB_AirLoopHVAC_FieldSet")

sizingzone = IB_SizingZone(Parameters_=objparams_6, dupNum=False)
objparams_8 = IB_ObjParams(FanEfficiency="0.54", MotorEfficiency="0.9", PressureRise="623", DataFieldSetType="Ironbug.HVAC.IB_FanOnOff_FieldSet")
fanonoff = IB_FanOnOff(Parameters_=objparams_8, dupNum=False)

# ----
# Sys03_SZAC
# Airloop
# HBZones
rooms_2 = Data(flatten(rooms))
lng = ListLength(List=rooms_2)
diffuser = Ironbug_AirTerminalSingleDuctUncontrolled(dupNum=False)
duplicate = Ironbug_Duplicate(Reference=diffuser, Amount=lng)  # -> Objects, graft(port)
thermalzone = Ironbug_ThermalZone(
    HoneybeeZonesOrOsZones=rooms_2,
    AirTerminal_=duplicate.Objects,
    SizingZone=sizingzone,
    IsAirTerminalPriorToZoneEquipments=True,
    dupNum=False)
panel_6 = Panel(supply_air_heating_temperature)
graft = GraftTree(Tree=thermalzone, IncludeEmptyLists=True, IncludeNullItems=True)
objparams_9 = IB_ObjParams(
    AllOutdoorAirinCooling=Toggle(False),
    AllOutdoorAirinHeating=Toggle(False),
    CentralHeatingDesignSupplyAirTemperature=panel_6,
    CentralHeatingMaximumSystemAirFlowRatio="1",
    SizingOption="Coincident",
    DataFieldSetType="Ironbug.HVAC.IB_SizingSystem_FieldSet")
panel_7 = Panel(supply_air_cooling_temperature)
panel_8 = Panel(supply_air_heating_temperature)
oasystem = Ironbug_OutdoorAirSystem()
spm_szreheat = Ironbug_SetpointManagerSingleZoneReheat(ControlZone=graft, MinTemperature=panel_7, MaxTemperature=panel_8, dupNum=False)
sizingsystem = Ironbug_SizingSystem(Parameters_=objparams_9, dupNum=False)
airloopbranches = AirLoopBranches(Branch1=graft)

unitarysystem = IB_AirLoopHVACUnitarySystem(HeatingCoil=coilhtngas, CoolingCoil=coilclndx1, Fan_=fanonoff, ControllingZone=graft, dupNum=False)
duplicate_2 = IB_Duplicate(Reference=oasystem, Amount=lng)  # -> graft(Objects), graft(port)

merge = Merge(Data1=simplify(duplicate_2.Objects), Data2=simplify(unitarysystem), Data3=simplify(spm_szreheat))
airloop = Ironbug_AirLoopHVAC(Supply=merge, Demand=airloopbranches, SizingSystem=sizingsystem, Parameters_=objparams_7, dupNum=False)
hvacsystem = Ironbug_HVACSystem(AirLoops=flatten(airloop))

hvacsystem_2 = ClusterOutput(hvacsystem)

# ==== cluster Cluster_5
rooms = ClusterInput()

# ----
# Heating Coil Performance Curves
# For Heat Pump
panel = Panel("20")
objparams = IB_ObjParams(MaximumValueofx=panel, MinimumValueofx="-20", DataFieldSetType="Ironbug.HVAC.Curves.IB_CurveCubic_FieldSet")
objparams_2 = IB_ObjParams(MaximumValueofx="1.5", MinimumValueofx="0.5", DataFieldSetType="Ironbug.HVAC.Curves.IB_CurveCubic_FieldSet")
objparams_3 = IB_ObjParams(MaximumValueofx="20", MinimumValueofx="-20", DataFieldSetType="Ironbug.HVAC.Curves.IB_CurveCubic_FieldSet")
panel_2 = Panel("""0.84
0.16
0
0""")
panel_3 = Panel("""1.19248
-0.0300438
0.00103745
-0.000023328""")
panel_4 = Panel("""0.758746
0.027626
0.000148716
0.0000034992""")
panel_5 = Panel("""0.85
0.15
0""")
panel_6 = Panel("""1.3824
-0.4336
0.0512""")
curvecubic = IB_CurveCubic(Coefficients=panel_2, Parameters_=objparams_2, dupNum=False)
curvequadratic = IB_CurveQuadratic(Coefficients=panel_5, dupNum=False)
curvecubic_2 = IB_CurveCubic(Coefficients=panel_4, Parameters_=objparams, dupNum=False)
curvequadratic_2 = IB_CurveQuadratic(Coefficients=panel_6, dupNum=False)
curvecubic_3 = IB_CurveCubic(Coefficients=panel_3, Parameters_=objparams_3, dupNum=False)
panel_7 = Panel(""" 0.297145
0.0430933
-0.000748766
0.00597727
0.000482112
-0.000956448""")
objparams_4 = IB_ObjParams(
    MaximumValueofx="29.44",
    MaximumValueofy="29.44",
    MinimumValueofx="-23.33",
    MinimumValueofy="-23.33",
    DataFieldSetType="Ironbug.HVAC.Curves.IB_CurveBiquadratic_FieldSet")
curvebiquadratic = IB_CurveBiquadratic(Coefficients=panel_7, Parameters_=objparams_4, dupNum=False)
objparams_5 = IB_ObjParams(
    CrankcaseHeaterCapacity="50",
    DefrostControl="OnDemand",
    DefrostEnergyInputRatioFunctionofTemperatureCurve=curvebiquadratic,
    DefrostStrategy="ReverseCycle",
    EnergyInputRatioFunctionofFlowFractionCurve=curvequadratic_2,
    EnergyInputRatioFunctionofTemperatureCurve=curvecubic_3,
    MaximumOutdoorDryBulbTemperatureforCrankcaseHeaterOperation="4.4",
    MaximumOutdoorDryBulbTemperatureforDefrostOperation="1.67",
    MinimumOutdoorDryBulbTemperatureforCompressorOperation="-12.2",
    PartLoadFractionCorrelationCurve=curvequadratic,
    RatedCOP="3.3",
    TotalHeatingCapacityFunctionofFlowFractionCurve=curvecubic,
    TotalHeatingCapacityFunctionofTemperatureCurve=curvecubic_2,
    DataFieldSetType="Ironbug.HVAC.IB_CoilHeatingDXSingleSpeed_FieldSet")

supply_air_cooling_temperature = Panel("12.78")
supply_air_heating_temperature = Panel("50")

# ----
# Cooling Coil Performance Curves
# For Heat Pump
panel_8 = Panel("1")
objparams_6 = IB_ObjParams(MaximumValueofx=panel_8, MinimumValueofx="0", DataFieldSetType="Ironbug.HVAC.Curves.IB_CurveQuadratic_FieldSet")
objparams_7 = IB_ObjParams(MaximumValueofx="1.5", MinimumValueofx="0.5", DataFieldSetType="Ironbug.HVAC.Curves.IB_CurveQuadratic_FieldSet")
panel_9 = Panel("""0.297145
0.0430933
-0.000748766
0.00597727
0.000482112
-0.000956448""")
objparams_8 = IB_ObjParams(
    MaximumValueofx="23.89",
    MaximumValueofy="46.11",
    MinimumValueofx="12.78",
    MinimumValueofy="21.1",
    DataFieldSetType="Ironbug.HVAC.Curves.IB_CurveBiquadratic_FieldSet")
panel_10 = Panel("""1.1552
-0.1816
0.0256""")
panel_11 = Panel("""0.85
0.15
0""")
curvequadratic_3 = IB_CurveQuadratic(Coefficients=panel_11, Parameters_=objparams_6, dupNum=False)
curvebiquadratic_2 = IB_CurveBiquadratic(Coefficients=panel_9, Parameters_=objparams_8, dupNum=False)
curvequadratic_4 = IB_CurveQuadratic(Coefficients=panel_10, Parameters_=objparams_7, dupNum=False)
objparams_9 = IB_ObjParams(MaximumValueofx="1.5", MinimumValueofx="0.5", DataFieldSetType="Ironbug.HVAC.Curves.IB_CurveQuadratic_FieldSet")
panel_12 = Panel("""0.766956
0.0107756
-0.0000414703
0.00134961
-0.000261144
0.000457488""")
objparams_10 = IB_ObjParams(
    MaximumValueofx="23.89",
    MaximumValueofy="46.11",
    MinimumValueofx="12.78",
    MinimumValueofy="21.1",
    DataFieldSetType="Ironbug.HVAC.Curves.IB_CurveBiquadratic_FieldSet")
panel_13 = Panel("""0.8
0.2
0""")
curvebiquadratic_3 = IB_CurveBiquadratic(Coefficients=panel_12, Parameters_=objparams_10, dupNum=False)
curvequadratic_5 = IB_CurveQuadratic(Coefficients=panel_13, Parameters_=objparams_9, dupNum=False)
objparams_11 = IB_ObjParams(
    EnergyInputRatioFunctionOfFlowFractionCurve=curvequadratic_4,
    EnergyInputRatioFunctionOfTemperatureCurve=curvebiquadratic_2,
    PartLoadFractionCorrelationCurve=curvequadratic_3,
    TotalCoolingCapacityFunctionOfFlowFractionCurve=curvequadratic_5,
    TotalCoolingCapacityFunctionOfTemperatureCurve=curvebiquadratic_3,
    DataFieldSetType="Ironbug.HVAC.IB_CoilCoolingDXSingleSpeed_FieldSet")

coilhtnelec = IB_CoilHeatingElectric(dupNum=False)

# ----
# Sys03_SZHP
# Airloop
# HBZones
rooms_2 = Data(flatten(rooms))
lng = ListLength(List=rooms_2)
diffuser = Ironbug_AirTerminalSingleDuctUncontrolled(dupNum=False)
duplicate = Ironbug_Duplicate(Reference=diffuser, Amount=lng)  # -> Objects, graft(port)
panel_14 = Panel(supply_air_heating_temperature)
panel_15 = Panel(supply_air_cooling_temperature)
panel_16 = Panel(supply_air_heating_temperature)
oasystem = Ironbug_OutdoorAirSystem()

objparams_12 = IB_ObjParams(
    ZoneCoolingDesignSupplyAirTemperature=supply_air_cooling_temperature,
    ZoneHeatingDesignSupplyAirTemperature=supply_air_heating_temperature,
    DataFieldSetType="Ironbug.HVAC.IB_SizingZone_FieldSet")
sizingzone = IB_SizingZone(Parameters_=objparams_12, dupNum=False)
objparams_13 = IB_ObjParams(
    MaximumOutdoorDryBulbTemperatureforSupplementalHeaterOperation="4.4",
    DataFieldSetType="Ironbug.HVAC.IB_AirLoopHVACUnitarySystem_FieldSet")
objparams_14 = IB_ObjParams(FanEfficiency="0.54", MotorEfficiency="0.9", PressureRise="623", DataFieldSetType="Ironbug.HVAC.IB_FanOnOff_FieldSet")
coilhtn_dx1 = IB_CoilHeatingDXSingleSpeed(Parameters_=objparams_5, dupNum=False)
coilclndx1 = IB_CoilCoolingDXSingleSpeed(Parameters_=objparams_11, dupNum=False)
fanonoff = IB_FanOnOff(Parameters_=objparams_14, dupNum=False)
objparams_15 = IB_ObjParams(NightCycleControlType="CycleOnAny", DataFieldSetType="Ironbug.HVAC.IB_AirLoopHVAC_FieldSet")
duplicate_2 = IB_Duplicate(Reference=oasystem, Amount=lng)  # -> graft(Objects), graft(port)

thermalzone = Ironbug_ThermalZone(
    HoneybeeZonesOrOsZones=rooms_2,
    AirTerminal_=duplicate.Objects,
    SizingZone=sizingzone,
    IsAirTerminalPriorToZoneEquipments=True,
    dupNum=False)
graft = GraftTree(Tree=thermalzone, IncludeEmptyLists=True, IncludeNullItems=True)
objparams_16 = IB_ObjParams(
    AllOutdoorAirinCooling=Toggle(False),
    AllOutdoorAirinHeating=Toggle(False),
    CentralHeatingDesignSupplyAirTemperature=panel_14,
    CentralHeatingMaximumSystemAirFlowRatio="1",
    SizingOption="Coincident",
    DataFieldSetType="Ironbug.HVAC.IB_SizingSystem_FieldSet")
spm_szreheat = Ironbug_SetpointManagerSingleZoneReheat(ControlZone=graft, MinTemperature=panel_15, MaxTemperature=panel_16, dupNum=False)
sizingsystem = Ironbug_SizingSystem(Parameters_=objparams_16, dupNum=False)
airloopbranches = AirLoopBranches(Branch1=graft)

unitarysystem = IB_AirLoopHVACUnitarySystem(
    HeatingCoil=coilhtn_dx1,
    CoolingCoil=coilclndx1,
    Fan_=fanonoff,
    SupplementalHeatingCoil=coilhtnelec,
    ControllingZone=graft,
    Parameters_=objparams_13,
    dupNum=False)

merge = Merge(Data1=simplify(duplicate_2.Objects), Data2=simplify(unitarysystem), Data3=simplify(spm_szreheat))
airloop = Ironbug_AirLoopHVAC(Supply=merge, Demand=airloopbranches, SizingSystem=sizingsystem, Parameters_=objparams_15, dupNum=False)
hvacsystem = Ironbug_HVACSystem(AirLoops=flatten(airloop))

hvacsystem_2 = ClusterOutput(hvacsystem)

# ==== cluster Cluster_6
rooms = ClusterInput()

objparams = IB_ObjParams(
    RatedInletAirTemperature="12.8",
    RatedOutletAirTemperature="50",
    DataFieldSetType="Ironbug.HVAC.IB_CoilHeatingWater_FieldSet")
objparams_2 = IB_ObjParams(
    CoolingDesignAirFlowMethod="DesignDayWithLimit",
    ZoneCoolingDesignSupplyAirTemperature="12.8",
    ZoneHeatingDesignSupplyAirTemperature="50",
    DataFieldSetType="Ironbug.HVAC.IB_SizingZone_FieldSet")
objparams_3 = IB_ObjParams(MaximumReheatAirTemperature="50", DataFieldSetType="Ironbug.HVAC.IB_AirTerminalSingleDuctVAVReheat_FieldSet")
objparams_4 = IB_ObjParams(
    RatedInletAirTemperature="7.2",
    RatedOutletAirTemperature="12.8",
    DataFieldSetType="Ironbug.HVAC.IB_CoilHeatingWater_FieldSet")
sizingzone = IB_SizingZone(Parameters_=objparams_2, dupNum=False)
objparams_5 = IB_ObjParams(NightCycleControlType="CycleOnAny", DataFieldSetType="Ironbug.HVAC.IB_AirLoopHVAC_FieldSet")

# ----
# Sys05_PackagedVAV_Reheat
# Airloop
# HBZones
rooms_2 = Data(flatten(rooms))
lng = ListLength(List=rooms_2)
coilhtnwater = Ironbug_CoilHeatingWater(Parameters_=objparams, dupNum=False)  # -> AirSide_CoilHeatingWater, WaterSide_CoilHeatingWater
duplicate = Ironbug_Duplicate(Reference=coilhtnwater.AirSide_CoilHeatingWater, Amount=flatten(lng))  # -> Objects, graft(WaterSide_CoilHeatingWater)
objparams_6 = IB_ObjParams(
    AllOutdoorAirinCooling=Toggle(False),
    AllOutdoorAirinHeating=Toggle(False),
    CentralHeatingDesignSupplyAirTemperature="12.8",
    DataFieldSetType="Ironbug.HVAC.IB_SizingSystem_FieldSet")
vavreheat = Ironbug_AirTerminalSingleDuctVAVReheat(HeatingCoil=duplicate.Objects, Parameters_=objparams_3, dupNum=False)
coilhtnwater_2 = Ironbug_CoilHeatingWater(Parameters_=objparams_4, dupNum=False)  # -> AirSide_CoilHeatingWater, WaterSide_CoilHeatingWater
oasystem = Ironbug_OutdoorAirSystem()
thermalzone = Ironbug_ThermalZone(
    HoneybeeZonesOrOsZones=rooms_2,
    AirTerminal_=vavreheat,
    SizingZone=sizingzone,
    IsAirTerminalPriorToZoneEquipments=True,
    dupNum=False)
coilclndx2 = Ironbug_CoilCoolingDXTwoSpeed(dupNum=False)
fanvariable = Ironbug_FanVariableVolume(dupNum=False)
spm_scheduled = Ironbug_SetpointManagerScheduled(Temperature="12.8", dupNum=False)
airloopbranches = AirLoopBranches(Branch1=thermalzone)
sizingsystem = Ironbug_SizingSystem(Parameters_=objparams_6, dupNum=False)
merge = Merge(Data1=oasystem, Data2=coilclndx2, Data3=coilhtnwater_2.AirSide_CoilHeatingWater, Data4=fanvariable, Data5=spm_scheduled)
airloop = Ironbug_AirLoopHVAC(Supply=merge, Demand=airloopbranches, SizingSystem=sizingsystem, Parameters_=objparams_5, dupNum=False)

# ----
# Hot water loop
panel = Panel("LeavingSetpointModulated")
objparams_7 = IB_ObjParams(
    BoilerFlowMode=panel,
    MaximumPartLoadRatio="1.2",
    NominalThermalEfficiency="0.84",
    DataFieldSetType="Ironbug.HVAC.IB_BoilerHotWater_FieldSet")
boilerhw = Ironbug_BoilerHotWater(Parameters=objparams_7, dupNum=False)
objparams_8 = IB_ObjParams(MinimumLoopTemperature="10", DataFieldSetType="Ironbug.HVAC.IB_PlantLoop_FieldSet")
pumpvariable = Ironbug_PumpVariableSpeed(dupNum=False)
branches = PlantBranches(Branch1=boilerhw, mapBranchToLoop=False)
branches_2 = PlantBranches(B1=duplicate.WaterSide_CoilHeatingWater, B2=coilhtnwater_2.WaterSide_CoilHeatingWater, mapBranchToLoop=False)
spm_scheduled_2 = Ironbug_SetpointManagerScheduled(Temperature="82", dupNum=False)
hwloop = Ironbug_HotWaterPlantLoop(Supply=[pumpvariable, branches, spm_scheduled_2], Demand=branches_2, Parameters=objparams_8, dupNum=False)

hvacsystem = Ironbug_HVACSystem(AirLoops=flatten(airloop), PlantLoops=flatten(hwloop))

hvacsystem_2 = ClusterOutput(hvacsystem)
